# Grasshopper definition DfM method for 3DCP.gh (Grasshopper 1.0.7)

# Copyright 2023. Tae-Kyung Kim all rights reserved.
# 
# Please when you use this material, cite the paper
number_slider = Slider(100, range=0..100)

# ---- group: Randomly drawed closed curve
curve = Curve(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)

# ----
divide_curve = DivideCurve(Curve=curve, Count=number_slider, Kinks="true")  # -> Points, Tangents, Parameters

# ----
# Randomly extruded surface
list_length = ListLength(List=divide_curve.Points)
construct_domain = ConstructDomain(DomainStart="0", DomainEnd=list_length)
random = Random(Range=construct_domain, Number=Slider(4, range=0..10), Seed=Slider(1, range=0..10))
height = Slider(300, range=0..1000)
number_slider_2 = Slider(50, range=0..50)
smooth_numbers = SmoothNumbers(Numbers=random, SmoothDelay=2000)
construct_domain_2 = ConstructDomain(DomainStart="0", DomainEnd=height)
list_item = ListItem(List=divide_curve.Points, Index=smooth_numbers, Wrap=True)
cull_duplicates = CullDuplicates(Points=list_item, Tolerance=0.1, CullMode=3)  # -> Points, Indices, Valence
range = Range(Domain=construct_domain_2, Steps=number_slider_2)
circle_fit = CircleFit(Points=cull_duplicates.Points)  # -> Circle, Radius, Deviation
bounds = Bounds(Numbers=range)
sort_along_curve = SortAlongCurve(Points=cull_duplicates.Points, Curve=circle_fit.Circle)  # -> Points, Indices
remap_numbers = RemapNumbers(Value=range, Source=bounds, Target=Domain(0, 1))  # -> Mapped, Clipped
polyline = PolyLine(Vertices=sort_along_curve.Points, Closed=invert(False))
graph_mapper = GraphMapper(
    remap_numbers.Mapped,
    x0=0,
    x1=1,
    y0=0,
    y1=1,
    amplitude=0.1636208296,
    container_name="Perlin",
    decay=0.4498270154,
    frequency=0.07002049685,
    x_offset=0.5599081516,
    y_offset=0.499260962)
height_2 = Slider(3000, range=0..3000)
scale = Scale(Geometry=polyline, Center=Point(0, 0, 0), Factor=graph_mapper)  # -> Geometry, Transform
construct_domain_3 = ConstructDomain(DomainStart="0", DomainEnd=height_2)
range_2 = Range(Domain=construct_domain_3, Steps=number_slider_2)
unit_z = UnitZ(Factor=range_2)
move = Move(Geometry=scale.Geometry, Motion=unit_z)  # -> Geometry, Transform
loft = Loft(
    Curves=flatten(move.Geometry),
    Options={Adjust=False, Closed=False, LoftEnds=0, LoftSimp=0, LoftType=0, Rebuild=10, Refit=0.01})
custom_preview = CustomPreview(Geometry=loft, Material=ColourSwatch(SwatchColor=RGB(176, 176, 176)))

# ----
# This algorithm evaluate manufacturability
# with simple manufacturing information
# (not the complicated design model)
nozzle_standoff_distance = Slider(8, range=0..50)
geometry = Geometry(loft)

# ---- group: Contour for generating G-code
contour = Contour(Shape=geometry, Point=Point(0, 0, 0), Direction=Vector(0, 0, 1), Distance=nozzle_standoff_distance)

# ----
# Inputs (example)
nozzle_standoff_distance_2 = ValueList({"8 mm": 8, "10 mm": 10, "12 mm": 12}, selected="8 mm")
nozzle_speed = ValueList({"4000 mm/min": 67, "4500 mm/min": 75, "5000 mm/min": 83}, selected="4500 mm/min")
# Buildability
material_density_kg_m_3 = Panel("2219.71")
τ_d_i_pa = Panel("1274")
a_thix_pa_s = Panel("1.2")
g = Panel("9.81")

list_item_2 = ListItem(List=flatten(contour), Index=0, Wrap=True)
explode = Explode(Curve=list_item_2, Recursive=True)  # -> Segments, Vertices
flip_curve = FlipCurve(Curve=explode.Segments)  # -> Curve, Flag
shift_list = ShiftList(List=explode.Segments, Shift=1, Wrap=True)
shift_paths = ShiftPaths(Data=shift_list, Offset=-1)
merge = Merge(Data1=graft(flip_curve.Curve), Data2=graft(shift_paths))
list_item_3 = ListItem(List=merge, Index=0, Wrap=True)  # -> Item, Item1
angle = Angle(VectorA=list_item_3.Item, VectorB=list_item_3.Item1)  # -> flatten(Angle), flatten(Reflex)
degrees = Degrees(Radians=angle.Reflex)
list_length_2 = ListLength(List=flip_curve.Curve)  # -> flatten(Length)
partition_list = PartitionList(List=degrees, Size=list_length_2)
ghpython_script = GhPythonScript(input_degrees=degrees)  # -> output_degrees; inputs input_degrees: list
# ---------- ghpython_script: Python ----------
__author__ = "TKKIM"
__version__ = "2023.04.04"

import rhinoscriptsyntax as rs

# create a list of input degree values
x = input_degrees

# create an empty list to hold the modified degree values
output_degrees = []

# iterate over each input degree value
for degree in input_degrees:
    # if the degree value is greater than 180, subtract it from 360
    if degree > 180:
        output_degree = 360 - degree
    else:
        output_degree = degree
    
    # add the modified degree value to the output list
    output_degrees.append(output_degree)

# output the modified degree values
print(output_degrees)
# ---------- end ghpython_script ----------
corner_threshold = Panel("89.99")
smaller_than = SmallerThan(FirstNumber=ghpython_script, SecondNumber=corner_threshold)  # -> SmallerThan, OrEqualTo
sort_list = SortList(Keys=flatten(ghpython_script))  # -> Keys, ValuesValuesA
reverse_list = ReverseList(List=sort_list.Keys)
dispatch = Dispatch(List=ghpython_script, DispatchPattern=smaller_than.SmallerThan)  # -> ListA, ListB
list_item_4 = ListItem(List=reverse_list, Index=0, Wrap=True)
list_item_5 = ListItem(List=sort_list.Keys, Index=0, Wrap=True)
member_index = MemberIndex(Set=ghpython_script, Member=dispatch.ListA)  # -> flatten(Index), Count
number = Number(list_item_4)
number_2 = Number(list_item_5)
addition = Addition(A=member_index.Index, B=1)
list_item_6 = ListItem(List=explode.Vertices, Index=addition, Wrap=True)
list_length_3 = ListLength(List=list_item_6)  # -> flatten(Length)
mass_addition = MassAddition(Input=list_length_3)  # -> Result, PartialResults
number_3 = Number(mass_addition.Result)

# ---- group: Athix graph
second = Slider(300, range=0..1000)
multiplication = Multiplication(A_thixPaS=a_thix_pa_s, B="60")
multiplication_2 = Multiplication(A=multiplication, B=second)
addition_2 = Addition(A=multiplication_2, ΤDIPa=τ_d_i_pa)
construct_point = ConstructPoint(XCoordinate=0, YCoordinate=τ_d_i_pa, ZCoordinate=0)
construct_point_2 = ConstructPoint(XCoordinate=second, YCoordinate=addition_2, ZCoordinate=0)
line = Line(StartPoint=construct_point, EndPoint=construct_point_2)

# ----
length = Length(Curve=contour)
print_path_length = Panel(length)
division = Division(A=print_path_length, NozzleSpeed=nozzle_speed)
second_per_print_path = Panel(division)
multiplication_3 = Multiplication(NozzleStandoffDistance=nozzle_standoff_distance_2, B=g, MaterialDensityKgM3=material_density_kg_m_3, D="0.001")  # -> flatten(Result)
mass_addition_2 = MassAddition(Input=flatten(second_per_print_path))  # -> Result, PartialResults
subtraction = Subtraction(A=mass_addition_2.PartialResults, B="0")
construct_domain_4 = Domain(DomainStart=flatten(["0", mass_addition_2.PartialResults]), DomainEnd=subtraction)
yield_stress_per_print_path = Panel(multiplication_3)
deconstruct_domain = DeconstructDomain(Domain=construct_domain_4)  # -> Start, End
list_length_4 = ListLength(List=deconstruct_domain.Start)
list_length_5 = ListLength(List=deconstruct_domain.Start)
subtraction_2 = Subtraction(A=list_length_4, B=1)
series = Series(Start=yield_stress_per_print_path, Step="0", Count=list_length_5)
split_list = SplitList(List=deconstruct_domain.Start, Index=subtraction_2)  # -> ListA, ListB
mass_addition_3 = MassAddition(Input=flatten(series))  # -> Result, PartialResults
construct_point_3 = ConstructPoint(XCoordinate=split_list.ListA, YCoordinate=mass_addition_3.PartialResults, ZCoordinate=0)
interpolate = Interpolate(Vertices=construct_point_3, Degree=3, Periodic=False, KnotStyle=1)  # -> Curve, Length, Domain
curve_curve = CurveCurve(CurveA=interpolate.Curve, CurveB=line)  # -> Points, ParamsA, ParamsB
# If here is no information, it's ok to be manufactured
deconstruct = Deconstruct(Point=curve_curve.Points)  # -> XComponent, YComponent, ZComponent
collapse_time_second = Panel(deconstruct.XComponent)

explode_2 = Explode(Curve=contour, Recursive=True)  # -> Segments, Vertices
point = Point(explode_2.Vertices)
flip_matrix = FlipMatrix(Data=point)
square = Square(Value=nozzle_standoff_distance)
overhang_threshold = Panel("7.1")
list_length_6 = ListLength(List=divide_curve.Points)  # -> flatten(Length)
number_of_corners = Panel(list_length_6)

# ---- group: Middle Vertices
shift = ShiftList(List=flip_matrix, Shift=1, Wrap=False)
cull_i = CullIndex(List=shift, Indices=-1, Wrap=True)

# ---- group: Start Vertices
cull_i_2 = CullIndex(List=flip_matrix, Indices=[-1, -2], Wrap=True)

# ----
distance = Distance(PointA=cull_i, PointB=cull_i_2)
square_2 = Square(Value=distance)
subtraction_3 = Subtraction(A=square_2, B=square)
square_root = SquareRoot(Value=subtraction_3)
larger_than = LargerThan(FirstNumber=square_root, SecondNumber=overhang_threshold)  # -> LargerThan, OrEqualTo
sort_list_2 = SortList(Keys=flatten(square_root))  # -> Keys, ValuesValuesA
reverse_list_2 = ReverseList(List=sort_list_2.Keys)
dispatch_2 = Dispatch(List=square_root, DispatchPattern=larger_than.LargerThan)  # -> ListA, ListB
list_item_7 = ListItem(List=reverse_list_2, Index=0, Wrap=True)
number_4 = Number(list_item_7)
# You can get number and locations of points that exceed the manufacturing constraints
member_index_2 = MemberIndex(Set=square_root, Member=dispatch_2.ListA)  # -> flatten(Index), Count
list_item_8 = ListItem(List=flip_matrix, Index=member_index_2.Index, Wrap=True)
list_length_7 = ListLength(List=list_item_8)  # -> flatten(Length)
mass_addition_4 = MassAddition(Input=list_length_7)  # -> Result, PartialResults
number_5 = Number(mass_addition_4.Result)
